# Grasshopper definition IAAC_rtde_test at recording IAAC.gh (Grasshopper 1.0.7)
# plug-ins: Robots, Firefly.X, Kangaroo Components

recording_at_iaac = Curve(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)
number_slider = Slider(20, range=0..100)

crv = Curve(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)  # disabled
crv_2 = Curve(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)  # disabled
curvepoint = PointOnCurve(crv, parameter=0.5)  # disabled
number_slider_2 = Slider(10, range=0..10)  # disabled
curvepoint_2 = PointOnCurve(crv_2, parameter=0.5)  # disabled
number_slider_3 = Slider(20, range=0..100)  # disabled
crv_3 = Curve(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)  # disabled
crv_4 = Curve(crv)  # disabled
dist = Distance(PointA=curvepoint_2, PointB=curvepoint)  # disabled
division = Division(A=dist, B=number_slider_3)  # disabled
range = Range(Domain=Domain(0, 1), Steps=division)  # disabled
tweencrv = TweenCurve(CurveA=crv_2, CurveB=crv, Factor=range, BlendType=0)  # disabled
tweencrv_2 = TweenCurve(CurveA=crv_3, CurveB=crv_4, Factor=range, BlendType=0)  # disabled
crv_5 = Curve([tweencrv_2, tweencrv])  # disabled

neg = Negative(Value=number_slider)
offset = OffsetCurve(Curve=recording_at_iaac, Distance=flatten(number_slider), Plane=PlaneXY(0, 0, 0), Corners=1)
boundary = BoundarySurfaces(Edges=offset)
X = UnitX(Factor=1)
contour = Contour(Shape=boundary, Point=Point(0, 0, 0), Direction=X, Distance=Slider(13, range=0..100))
crv_6 = Curve([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])  # disabled
crv_7 = Curve(flatten(contour))
crv_8 = Curve(crv_7)
crv_9 = Curve(flatten(crv_8))
end = EndPoints(Curve=crv_9)  # -> Start, End
pdecon = Deconstruct(Point=end.Start)  # -> XComponent, YComponent, ZComponent
sort = SortList(Keys=pdecon.XComponent, ValuesA=crv_9)  # -> Keys, ValuesA
dispatch = Dispatch(List=flatten(sort.ValuesA), DispatchPattern=[True, False])  # -> ListA, ListB
flip = FlipCurve(Curve=dispatch.ListA)  # -> Curve, Flag
number_slider_4 = Slider(50, range=0..100)
weave = Weave(Pattern=[0, 1], Stream0=flip.Curve, Stream1=dispatch.ListB, NullGaps=False)
ext = ExtendCurve(Curve=weave, Type=0, Start=number_slider_4, End=number_slider_4)
connect = ConnectCurves(Curves=ext, Continuity=0, Close=invert(True), Bulge=1)

# ---- group: BASE CALIBRATION
safety = Panel("15")
addition = Addition(A="25", B=safety)
Z = UnitZ(Factor=addition)
move = Move(Geometry=connect, Motion=Z)  # -> Geometry, Transform

# ----
Z_2 = UnitZ(Factor=1)
move_2 = Move(Geometry=move.Geometry, Motion=Z_2)  # -> Geometry, Transform
divdist = DivideDistance(Curve=move_2.Geometry, Distance="1")  # -> Points, Tangents, Parameters
neg_2 = Negative(Value=Slider(32, range=0..100))
xy = XYPlane(Origin=divdist.Points)
vec = VectorXYZ(XComponent=0, YComponent=neg_2, ZComponent=Slider(37, range=0..100))  # -> Vector, Length
Z_3 = UnitZ(Factor=Slider(37, range=0..100))
move_3 = Move(Geometry=xy, Motion=vec.Vector)  # -> Geometry, Transform
X_2 = UnitX(Factor=1)
rot3d = Rotate3D(Geometry=move_3.Geometry, Angle=degrees(Slider(20, range=0..100)), Center=move_3.Geometry, Axis=X_2)  # -> Geometry, Transform
item = ListItem(List=move_3.Geometry, Index=0, Wrap=True)  # -> Item1, Item
Z_4 = UnitZ(Factor=Slider(70, range=0..100))
move_4 = Move(Geometry=item.Item1, Motion=Z_4)  # -> Geometry, Transform
move_5 = Move(Geometry=item.Item, Motion=Z_4)  # -> Geometry, Transform
merge = Merge(Data1=move_5.Geometry, Data2=move_5.Geometry, Data3=move_3.Geometry, Data4=move_4.Geometry)
pdecon_2 = Deconstruct(Point=merge)  # -> expr("x/1000", graft(XComponent)), expr("x/1000", graft(YComponent)), expr("x/1000", graft(ZComponent))
join = TextJoin(Text=[pdecon_2.XComponent, pdecon_2.YComponent, pdecon_2.ZComponent], Join=",")
data = Data(flatten(join))
panel = Panel(data)

panel_2 = Panel(Slider(0, range=0..0.35))
neg_3 = Negative(Value="0.34")
y_rotation = Data(panel_2)

number_slider_5 = Slider(0.5, range=0..1)

panel_3 = Panel(Slider(0, range=0..0.34))
panel_4 = Panel("0.34")
neg_4 = Negative(Value=panel_3)
z_rotation = Data(neg_4)

panel_6 = Panel("0")
neg_5 = Negative(Value=Slider(0.34, range=0..0.34))
x_rotation = Data(neg_5)

pflip = FlipPlane(Plane=merge, ReverseX=False, ReverseY=False, SwapAxes=True)
addition_2 = Addition(A="3.14", B=x_rotation)
concat = Concatenate(
    FragmentA=join,
    FragmentB=",",
    FragmentC=addition_2,
    FragmentD=",",
    FragmentE=y_rotation,
    FragmentF=",",
    FragmentG=z_rotation)  # -> flatten(Result)
panel_7 = Panel(concat)
data_2 = Data(flatten(concat))

list = ValueList({"AA-KR60", "AA-KR30", "AA-KR60_KR30", "AARCH IRB120", "AARCH IRB6620", "Bartlett-IRB120", "Bartlett-IRB1600", "Bartlett-KR6", "Bartlett-KR60", "Bartlett-UR10", "Bigli-KR20", "ETH-Gantry", "Grymsdyke-IRB120", "Grymsdyke-KR210", "iaac-KR150-2_110", "iaac-IRB140", "iaac-IRB120", "EXArchitects-IRB6700", "Construmat-IRB6700_235", "KULeuven-IRB120", "KULeuven-UR5", "KULeuven-UR10", "IRB4600-205", "UEL IRB6620", "uem-IRB120", "uem-IRB1600", "uem-IRB2600", "uem-IRB1600_IRB2600", "UniMelb-IRB120", "UniMelb-IRB1200"}, selected="KULeuven-UR10")
load_robot = LoadRobotSystem(Name=list, Base=PlaneXY(0, 0, 0))

timer = Timer(TimerInterval=20, Target=counter)  # disabled
# ONLINE
data_3 = Data(data_2)
counter = Counter(Reset=Button())
data_4 = Data(data_3)
lng = ListLength(List=data_4)  # -> expr("x-1", Length)
min = Minimum(A=lng, B=counter)
item_2 = ListItem(List=pflip, Index=min, Wrap=True)
item_3 = ListItem(List=data_4, Index=min, Wrap=True)

pt = Point(Point(0, 0, 0))
xy_2 = XYPlane(Origin=pt)
mesh = Mesh(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)
tool = CreateTool(Name="raven_claw", TCP=xy_2, Weight=0, Mesh=mesh)  # -> Tool, TCP

panel_8 = Panel(min)

X_3 = UnitX(Factor=1)
rot3d_2 = Rotate3D(Geometry=item_2, Angle=x_rotation, Center=item_2, Axis=X_3)  # -> Geometry, Transform

# ---- group: Please Check
panel_9 = Panel("127.0.0.1")
panel_10 = Panel("8000")

# ----
Z_5 = UnitZ(Factor=1)
rot3d_3 = Rotate3D(Geometry=rot3d_2.Geometry, Angle=y_rotation, Center=rot3d_2.Geometry, Axis=Z_5)  # -> Geometry, Transform

udp_sender = UDPSender(Data=item_3, IPAddressOfUDPServer=panel_9, UDPPort=panel_10)  # disabled

Z_6 = UnitZ(Factor=1)
rot3d_4 = Rotate3D(Geometry=rot3d_3.Geometry, Angle=z_rotation, Center=rot3d_3.Geometry, Axis=Z_6)  # -> Geometry, Transform

live_point = Data(rot3d_4.Geometry)
all_points = Data(pflip)  # disabled

# ----
# VISUALIZATION
panel_11 = Panel("kunal")
target = CreateTarget(Plane=live_point, Tool=tool.Tool, Speed="100", Zone="2", IsCartesian=True)
program = CreateProgram(Name=panel_11, RobotSystem=load_robot, Targets1=flatten(target), StepSize=1)  # -> Program, Code, Duration, Warnings, Errors
sim = ProgramSimulation(Program=program.Program, Time=Slider(0, range=0..1), Normalized=True)  # -> SystemMeshes, JointRotations, Plane, Index, Time, Program, Errors
decprogtarg = DeconstructProgramTargets(Program=program.Program)  # -> Planes, Joints, Configuration, DeltaTime

panel_12 = Panel(decprogtarg.Joints)
