# Grasshopper definition UR_rtde_sample.ghx (Grasshopper 1.0.7)
# plug-ins: Robots, Kangaroo Components, Firefly.X

crv = Curve(<curve referenced from the Rhino model>)
Z = UnitZ(Factor=Slider(3, range=0..10))
repeat = RepeatData(Data=crv, Length="2")
move = Move(Geometry=repeat, Motion=Z)  # -> Geometry, Transform
divdist = DivideDistance(Curve=move.Geometry, Distance="5")  # -> Points, Tangents, Parameters
xy = XYPlane(Origin=divdist.Points)
pflip = FlipPlane(Plane=xy, ReverseX=False, ReverseY=False, SwapAxes=True)  # -> flatten(Plane)
pdecon = Deconstruct(Point=pflip)  # -> expr("x/1000", graft(XComponent)), expr("x/1000", graft(YComponent)), expr("x/1000", graft(ZComponent))
pdecon_2 = Deconstruct(Point=pflip)  # -> graft(XComponent), graft(YComponent), graft(ZComponent)
list = RobotsLibrary(
    {"AA-KR60", "AA-KR30", "AA-KR60_KR30", "AARCH IRB120", "AARCH IRB6620", "AAU-Utzon-UR10", "Automata", "Bartlett-IRB120", "Bartlett-IRB1600", "Bartlett-KR6"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}, selected="KULeuven-UR10",
    Type=0)
join = TextJoin(Text=[pdecon_2.XComponent, pdecon_2.YComponent, pdecon_2.ZComponent], Join=",")
join_2 = TextJoin(Text=[pdecon.XComponent, pdecon.YComponent, pdecon.ZComponent], Join=",")
python = GhPythonScript(Plane=pflip)  # -> out, X, Y, Z, Q1, Q2, Q3, Q4
# ---------- python: Python ----------
__author__ = "kunal"
__version__ = "2019.04.22"

import rhinoscriptsyntax as rs
import Rhino.Geometry as rg

rot = rg.Quaternion.Rotation(rs.WorldXYPlane(), x)

Q1 = rot.A
Q2 = rot.B
Q3 = rot.C
Q4 = rot.D

o = x.Origin
X = o.X
Y = o.Y
Z = o.Z

print X
#print rot.A
#print rot.B
#print rot.C
#print rot.D
# ---------- end python ----------

# ---- group: Position + time + Look ahead + Gain
merge = Merge(Data1=Slider(0.5, range=0..3), Data2=Slider(0.1, range=0.03..0.2), Data3=Slider(1000, range=100..1000))
panel = Panel(",")

# ----
item = ListItem(List=flatten(join), Index="0", Wrap=True)
list_2 = ValueList({"Joint", "Linear"}, selected="Joint")
panel_2 = Panel(item)
loadrobot = LoadRobotSystem(Name=list, Base=PlaneXY(0, 0, 0))
concat = Concatenate(FragmentB=join_2, FragmentD=",0,-3.14,0")  # -> flatten(Result)
target = CreateTarget(Plane=pflip, Motion=list_2, Speed=Slider(100, range=0..100), Zone=Slider(10, range=0..100), IsCartesian=True)

join_3 = TextJoin(Text=merge, Join=panel)
concat_2 = Concatenate(FragmentB=join_2, FragmentD=",0,-3.14,0", FragmentC=join_3)  # -> flatten(Result)
panel_3 = Panel(concat_2)

program = CreateProgram(Name="kunal", RobotSystem=loadrobot, Targets=target, StepSize=1)  # -> Program, Code, Duration, Warnings, Errors
panel_4 = Panel(concat)
decprogtarg = DeconstructProgramTargets(Program=program.Program)  # -> Planes, Joints, Configuration, DeltaTime
sim = ProgramSimulation(Program=program.Program, Time=Slider(0.72, range=0..1), Normalized=True)  # -> SystemMeshes, JointRotations, Plane, Index, Time, Program, Errors
remote = RemoteConnection(Program=program.Program, IP="192.168.0.23", Upload=Button(), Play=False, Pause=Button())
button = Button()
timer = Timer(Interval=5, TimerInterval=5, Target=[counter, counter_3])  # disabled
data = Data(concat)
counter = Counter(Reset=button)
data_2 = Data(data)
counter_2 = Counter(CountDirection=True, Step=1, StartStop=True, Reset=False, OptionalCounterDomain=Domain(0, 100))
lng = ListLength(List=data_2)  # -> expr("x-1", Length)
counter_3 = Counter(CountDirection=button, Step=1, StartStop=True, Reset=False, OptionalCounterDomain=Domain(0, 100))
min = Minimum(A=lng, B=counter_3)
addition = Addition()
panel_5 = Panel(counter_3)
item_2 = ListItem(List=data_2, Index=min, Wrap=True)
panel_6 = Panel(item_2)

# ---- group: Please Check
panel_7 = Panel("127.0.0.1")
panel_8 = Panel("7000")

# ----
udp_sender = UDPSender(Data=item_2, IPAddressOfUDPServer=panel_7, UDPPort=panel_8)
